# Grasshopper definition EvenValenceRemesh.gh (Grasshopper 1.0.7)
# plug-ins: PlanktonGh, Kangaroo Components

mesh = Mesh(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)
c_script = CSharpScript(
    unevenmesh=mesh,
    reset=Button(),
    Reference=["C:\USERS\YANGW\APPDATA\ROAMING\GRASSHOPPER\LIBRARIES\KANGAROO0099\Plankton.dll", "C:\USERS\YANGW\APPDATA\ROAMING\GRASSHOPPER\LIBRARIES\KANGAROO0099\PlanktonGh.dll"])  # -> out, A, B, C; inputs unevenmesh: Mesh, reset: Boolean
# ---------- c_script: C# usings ----------
using Plankton;
using PlanktonGh;
# ---------- c_script: C# ----------
    PlanktonMesh P = unevenmesh.ToPlanktonMesh();
    int ec = P.Halfedges.Count / 2;
    List<int> vals = new List<int>();

    for(int i = 0; i < P.Vertices.Count;i++)
    {
      int he = P.Vertices[i].OutgoingHalfedge;
      int val = 0;
      foreach(int nh in P.Halfedges.GetVertexCirculator(he))
      {
        if(P.Halfedges[nh].AdjacentFace == -1){val = 0;break;}
        val++;
      }
      vals.Add(val);
    }
    A = new List<int>(vals.ToArray());
    //flip
    for(int i = 0; i < ec;i++)
    {
      int vs = P.Halfedges[2 * i].StartVertex;
      int ve = P.Halfedges[2 * i + 1].StartVertex;
      if (!P.Halfedges[2 * i].IsUnused && vals[vs] != 0 && vals[ve] != 0)
      {
        int vl = P.Halfedges[P.Halfedges[2 * i].PrevHalfedge].StartVertex;
        int vr = P.Halfedges[P.Halfedges[2 * i + 1].PrevHalfedge].StartVertex;
        //now
        int val_s = vals[vs];
        int val_e = vals[ve];
        int val_l = vals[vl];
        int val_r = vals[vr];
        int bias1 = val_s % 2 + val_e % 2 + val_l % 2 + val_r % 2;
        //after
        val_s -= 1;
        val_e -= 1;
        val_l += val_l > 0 ? 1 : 0;
        val_r += val_r > 0 ? 1 : 0;
        int bias2 = val_s % 2 + val_e % 2 + val_l % 2 + val_r % 2;
        if(bias2 < bias1)
        {
          P.Halfedges.FlipEdge(2 * i);
          vals[vs] = val_s;
          vals[ve] = val_e;
          vals[vl] = val_l;
          vals[vr] = val_r;Print("1");
        }
      }
    }
    //split
    for(int i = 0; i < ec;i++)
    {
      int vs = P.Halfedges[2 * i].StartVertex;
      int ve = P.Halfedges[2 * i + 1].StartVertex;
      if (!P.Halfedges[2 * i].IsUnused && vals[vs] != 0 && vals[ve] != 0)
      {
        int vl = P.Halfedges[P.Halfedges[2 * i].PrevHalfedge].StartVertex;
        int vr = P.Halfedges[P.Halfedges[2 * i + 1].PrevHalfedge].StartVertex;
        if(vals[vl] % 2 != 0 && vals[vr] % 2 != 0)
        {
          P.Halfedges.TriangleSplitEdge(2 * i);
          vals[vl] += 1;
          vals[vr] += 1;
          vals.Add(4);
        }
      }
    }
    C = vals;
    B = P;
# ---------- end c_script ----------
renameplz = Panel("1000")
c_script_2 = CSharpScript(x=c_script.C)  # -> out, A; inputs x: Int32
# ---------- c_script_2: C# ----------
    A = x == 0;
# ---------- end c_script_2 ----------
planktonmesh = PlanktonMesh(c_script.B)
c_script_3 = CSharpScript(x=c_script.C)  # -> out, A; inputs x: Int32
# ---------- c_script_3: C# ----------
    A = x % 2 == 0;
# ---------- end c_script_3 ----------
c_script_4 = CSharpScript(x=c_script.A)  # -> out, A; inputs x: Int32; same code as c_script_3
mesh_2 = Mesh(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)
gate_not = GateNot(A=c_script_3.A)
mesh_3 = Mesh(planktonmesh)
number_slider = Slider(100, range=0..100)
gate_not_2 = GateNot(A=c_script_4.A)
triangulate = Triangulate(Mesh=mesh_2)  # -> Mesh, Count
c_script_5 = CSharpScript(
    reduceduneven=mesh_3,
    uneven=gate_not,
    naked=c_script_2.A,
    Reference=["C:\USERS\YANGW\APPDATA\ROAMING\GRASSHOPPER\LIBRARIES\KANGAROO0099\Plankton.dll", "C:\USERS\YANGW\APPDATA\ROAMING\GRASSHOPPER\LIBRARIES\KANGAROO0099\PlanktonGh.dll"])  # -> out, path; inputs reduceduneven: Mesh, uneven: list of Boolean, naked: list of Boolean
# ---------- c_script_5: C# ----------
    var p = reduceduneven.ToPlanktonMesh();
    List<int> vs = new List<int>();
    int h = 0;
    foreach(var u in uneven)
    {
      if(u)
      {
        vs.Add(h);
      }
      h++;
    }

    int[] uneven_vertices = vs.ToArray();
    int[] uneven_pairs = new int[uneven_vertices.Length];
    bool[] ispaired = new bool[uneven_vertices.Length];
    int[][] backtrack_halfedges = new int[uneven_vertices.Length][];
    List<int> edges = new List<int>();
    bool[] isinpath = new bool[p.Faces.Count];

    for(int i = 0;i < uneven_vertices.Length;i++)
    {
      if(!ispaired[i])
      {
        int[] queue = new int[p.Vertices.Count];
        bool[] inqueue = new bool[p.Vertices.Count];
        int quelast = -1;
        int quepointer = 0;
        int[] backrecords = new int[p.Vertices.Count];
        int[] edgerecords = new int[p.Vertices.Count];

        //start bfs
        quelast++;
        queue[quelast] = uneven_vertices[i];
        inqueue[uneven_vertices[i]] = true;
        while( quelast >= quepointer)
        {
          int vhere = queue[quepointer];
          quepointer++;

          foreach(int nh in p.Halfedges.GetVertexCirculator(p.Vertices[vhere].OutgoingHalfedge))
          {
            if(p.Halfedges[nh].AdjacentFace != -1
              && p.Halfedges[p.Halfedges.GetPairHalfedge(p.Halfedges[nh].NextHalfedge)].AdjacentFace != -1)
            {
              int nexth = p.Halfedges[nh].NextHalfedge;
              int nextv = p.Halfedges[p.Halfedges[p.Halfedges.GetPairHalfedge(nexth)].PrevHalfedge].StartVertex;
              int nextf1 = p.Halfedges[nh].AdjacentFace;
              int nextf2 = p.Halfedges[p.Halfedges.GetPairHalfedge(nexth)].AdjacentFace;
              if (!inqueue[nextv] && !isinpath[nextf1] && !isinpath[nextf2])
              {
                backrecords[nextv] = vhere;
                edgerecords[nextv] = nexth;
                if(uneven[nextv] || naked[nextv])
                {
                  int targetindex = vs.IndexOf(nextv);
                  if(targetindex != -1)
                  {
                    if(ispaired[targetindex] == true)
                    {
                      inqueue[nextv] = true;
                      quelast++;
                      queue[quelast] = nextv;
                    }
                    else
                    {
                      uneven_pairs[i] = nextv;
                      ispaired[i] = true;
                      uneven_pairs[targetindex] = uneven_vertices[i];
                      ispaired[targetindex] = true;

                      List<int> backhs = new List<int>();
                      int backptr = nextv;
                      while(backptr != uneven_vertices[i])
                      {
                        backhs.Add(edgerecords[backptr]);
                        isinpath[p.Halfedges[edgerecords[backptr]].AdjacentFace] = true;
                        isinpath[p.Halfedges[p.Halfedges.GetPairHalfedge(edgerecords[backptr])].AdjacentFace] = true;
                        edges.Add(edgerecords[backptr]);
                        backptr = backrecords[backptr];
                      }
                      backtrack_halfedges[i] = backhs.ToArray();
                      backtrack_halfedges[targetindex] = null;
                      quepointer = 0;
                      quelast = -1;
                      break;
                    }
                  }
                  else
                  {
                    uneven_pairs[i] = nextv;
                    ispaired[i] = true;

                    List<int> backhs = new List<int>();
                    int backptr = nextv;
                    while(backptr != uneven_vertices[i])
                    {
                      backhs.Add(edgerecords[backptr]);
                      edges.Add(edgerecords[backptr]);
                      isinpath[p.Halfedges[edgerecords[backptr]].AdjacentFace] = true;
                      isinpath[p.Halfedges[p.Halfedges.GetPairHalfedge(edgerecords[backptr])].AdjacentFace] = true;
                      backptr = backrecords[backptr];
                    }
                    backtrack_halfedges[i] = backhs.ToArray();
                    quepointer = 0;
                    quelast = -1;
                    break;
                  }
                }
                else
                {
                  inqueue[nextv] = true;
                  quelast++;
                  queue[quelast] = nextv;
                }
              }
            }
          }
        }
      }
    }
    path = edges;
# ---------- end c_script_5 ----------
gate_and = GateAnd(A=gate_not_2, B=c_script_3.A)
combine_clean = CombineClean(Meshes=triangulate.Mesh)
c_script_6 = CSharpScript(
    mesh=combine_clean,
    length=Slider(2.78, range=1..10),
    iters=Slider(133, range=0..1000),
    Reference=["C:\Users\yangw\AppData\Roaming\Grasshopper\Libraries\kangaroo0099\Plankton.dll", "C:\Users\yangw\AppData\Roaming\Grasshopper\Libraries\PlanktonGh.dll"])  # -> out, A; inputs mesh: Mesh, length: Double, iters: Int32
# ---------- c_script_6: C# usings ----------
using Plankton;
using PlanktonGh;
using System.Threading.Tasks;
# ---------- c_script_6: C# ----------
    double PullStrength = 1;
    double SmoothStrength = 1;
    double LengthTol = 0.01;

    PlanktonMesh P = mesh.ToPlanktonMesh();
    Mesh M = mesh;
    for (int iter = 0; iter < iters; iter++)
    {
      int EdgeCount = P.Halfedges.Count / 2;
      double[] EdgeLength = P.Halfedges.GetLengths();
      List<bool> Visited = new List<bool>();
      Vector3d[] Normals = new Vector3d[P.Vertices.Count];
      for (int i = 0; i < P.Vertices.Count; i++)
      {
        Visited.Add(false);
        Normals[i] = Normal(P, i);
      }

      double t = LengthTol;     //a tolerance for when to split/collapse edges
      double smooth = SmoothStrength;  //smoothing strength
      double pull = PullStrength;  //pull to target mesh strength

      // Split the edges that are too long
      for (int i = 0; i < EdgeCount; i++)
      {
        if (P.Halfedges[2 * i].IsUnused == false)
        {
          int vStart = P.Halfedges[2 * i].StartVertex;
          int vEnd = P.Halfedges[2 * i + 1].StartVertex;

          if ((Visited[vStart] == false)
            && (Visited[vEnd] == false))
          {
            double L2 = length;

            if (EdgeLength[2 * i] > (1 + t) * (4f / 3f) * L2)
            {

              int SplitHEdge = P.Halfedges.TriangleSplitEdge(2 * i);
              if (SplitHEdge != -1)
              {
                int SplitCenter = P.Halfedges[SplitHEdge].StartVertex;
                //P.Vertices.SetVertex(SplitCenter, MidPt(P, i));
                Visited.Add(true);
                /*
                int[] Neighbours = P.Vertices.GetVertexNeighbours(SplitCenter);
                foreach (int n in Neighbours)
                { Visited[n] = true; }
                */
              }
            }
          }
        }
      }

      //Collapse the edges that are too short
      for (int i = 0; i < EdgeCount; i++)
      {
        if (P.Halfedges[2 * i].IsUnused == false)
        {
          int vStart = P.Halfedges[2 * i].StartVertex;
          int vEnd = P.Halfedges[2 * i + 1].StartVertex;
          if ((Visited[vStart] == false)
            && (Visited[vEnd] == false))
          {
            double L2 = length;
            if (EdgeLength[2 * i] < (1 - t) * 4f / 5f * L2)
            {
              int Collapsed = -1;
              int CollapseRtn = -1;
              Collapsed = P.Halfedges[2 * i].StartVertex;
              P.Vertices.SetVertex(Collapsed, MidPt(P, i));
              CollapseRtn = P.Halfedges.CollapseEdge(2 * i);
              if (CollapseRtn != -1)
              {
                Visited[Collapsed] = true;
                /*
                int[] Neighbours = P.Vertices.GetVertexNeighbours(Collapsed);
                foreach (int n in Neighbours)
                { Visited[n] = true; }
                */
              }
            }
          }
        }
      }

      P.Compact(); //this cleans the mesh data structure of unused elements

      EdgeCount = P.Halfedges.Count / 2;
      if (PullStrength > 0)
      {
        //Flip edges to reduce valence error
        for (int i = 0; i < EdgeCount; i++)
        {
          if (!P.Halfedges[2 * i].IsUnused
            && (P.Halfedges[2 * i].AdjacentFace != -1)
            && (P.Halfedges[2 * i + 1].AdjacentFace != -1)
            )
          {
            int Vert1 = P.Halfedges[2 * i].StartVertex;
            int Vert2 = P.Halfedges[2 * i + 1].StartVertex;
            int Vert3 = P.Halfedges[P.Halfedges[P.Halfedges[2 * i].NextHalfedge].NextHalfedge].StartVertex;
            int Vert4 = P.Halfedges[P.Halfedges[P.Halfedges[2 * i + 1].NextHalfedge].NextHalfedge].StartVertex;

            int Valence1 = P.Vertices.GetValence(Vert1);
            int Valence2 = P.Vertices.GetValence(Vert2);
            int Valence3 = P.Vertices.GetValence(Vert3);
            int Valence4 = P.Vertices.GetValence(Vert4);

            if (P.Vertices.NakedEdgeCount(Vert1) > 0) { Valence1 += 2; }
            if (P.Vertices.NakedEdgeCount(Vert2) > 0) { Valence2 += 2; }
            if (P.Vertices.NakedEdgeCount(Vert3) > 0) { Valence3 += 2; }
            if (P.Vertices.NakedEdgeCount(Vert4) > 0) { Valence4 += 2; }

            int CurrentError =
              Math.Abs(Valence1 - 6) +
              Math.Abs(Valence2 - 6) +
              Math.Abs(Valence3 - 6) +
              Math.Abs(Valence4 - 6);
            int FlippedError =
              Math.Abs(Valence1 - 7) +
              Math.Abs(Valence2 - 7) +
              Math.Abs(Valence3 - 5) +
              Math.Abs(Valence4 - 5);

            int CurrentEvenError = Valence1 % 2 + Valence2 % 2 + Valence3 % 2 + Valence4 % 2;
            int FlippedEvenError = (Valence1 - 1) % 2 + (Valence2 - 1) % 2 + (Valence3 + 1) % 2 + (Valence4 + 1) % 2;

            if (CurrentError > FlippedError /*&& CurrentEvenError >= FlippedEvenError*/)
            {
              P.Halfedges.FlipEdge(2 * i);
            }
            /*
            //Flip edges based on angle
            if (!P.Halfedges[2 * i].IsUnused
              && (P.Halfedges[2 * i].AdjacentFace != -1)
              && (P.Halfedges[2 * i + 1].AdjacentFace != -1)
              )
            {
              int Vert1 = P.Halfedges[2 * i].StartVertex;
              int Vert2 = P.Halfedges[2 * i + 1].StartVertex;
              int Vert3 = P.Halfedges[P.Halfedges[P.Halfedges[2 * i].NextHalfedge].NextHalfedge].StartVertex;
              int Vert4 = P.Halfedges[P.Halfedges[P.Halfedges[2 * i + 1].NextHalfedge].NextHalfedge].StartVertex;

              Point3d P1 = P.Vertices[Vert1].ToPoint3d();
              Point3d P2 = P.Vertices[Vert2].ToPoint3d();
              Point3d P3 = P.Vertices[Vert3].ToPoint3d();
              Point3d P4 = P.Vertices[Vert4].ToPoint3d();

              double A1 = Vector3d.VectorAngle(new Vector3d(P3 - P1), new Vector3d(P4 - P1))
                + Vector3d.VectorAngle(new Vector3d(P4 - P2), new Vector3d(P3 - P2));

              double A2 = Vector3d.VectorAngle(new Vector3d(P1 - P4), new Vector3d(P2 - P4))
                + Vector3d.VectorAngle(new Vector3d(P2 - P3), new Vector3d(P1 - P3));

              int Valence1 = P.Vertices.GetValence(Vert1);
              int Valence2 = P.Vertices.GetValence(Vert2);
              int Valence3 = P.Vertices.GetValence(Vert3);
              int Valence4 = P.Vertices.GetValence(Vert4);

              int CurrentEvenError = Valence1 % 2 + Valence2 % 2 + Valence3 % 2 + Valence4 % 2;
              int FlippedEvenError = (Valence1 - 1) % 2 + (Valence2 - 1) % 2 + (Valence3 + 1) % 2 + (Valence4 + 1) % 2;

              if (A2 > A1 && CurrentEvenError >= FlippedEvenError)
              {
                P.Halfedges.FlipEdge(2 * i);
              }
            }*/
          }
        }
      }

      if(iter == iters - 1)
      {
        EvenRemesh(P);
        P.Compact();
      }

      Vector3d[] Smooth = LaplacianSmooth(P, 0, smooth);

      Parallel.For(0, P.Vertices.Count, i =>
        {
        // make it tangential only
        Vector3d VNormal = Normal(P, i);
        double ProjLength = Smooth[i] * VNormal;
        Smooth[i] = Smooth[i] - (VNormal * ProjLength);

        P.Vertices.MoveVertex(i, Smooth[i]);

        if (P.Vertices.NakedEdgeCount(i) != 0)//special smoothing for feature edges
        {
          int[] Neighbours = P.Vertices.GetVertexNeighbours(i);
          int ncount = 0;
          Point3d Avg = new Point3d();

          for (int j = 0; j < Neighbours.Length; j++)
          {
            if (P.Vertices.NakedEdgeCount(Neighbours[j]) != 0)
            {
              ncount++;
              Avg = Avg + P.Vertices[Neighbours[j]].ToPoint3d();
            }
          }
          Avg = Avg * (1.0 / ncount);
          Vector3d move = Avg - P.Vertices[i].ToPoint3d();
          move = move * smooth;
          P.Vertices.MoveVertex(i, move);
        }

        if (PullStrength > 0)
        {
          Point3d Point = P.Vertices[i].ToPoint3d();
          Vector3d normal = Normal(P, i);
          Ray3d Ray1 = new Ray3d(Point, normal);
          Ray3d Ray2 = new Ray3d(Point, -normal);
          double RayPt1 = Rhino.Geometry.Intersect.Intersection.MeshRay(M, Ray1);
          double RayPt2 = Rhino.Geometry.Intersect.Intersection.MeshRay(M, Ray2);
          Point3d ProjectedPt;

          if ((RayPt1 < RayPt2) && (RayPt1 > 0) && (RayPt1 < 1.0))
          {
            ProjectedPt = Point * (1 - pull) + pull * Ray1.PointAt(RayPt1);
          }
          else if ((RayPt2 < RayPt1) && (RayPt2 > 0) && (RayPt2 < 1.0))
          {
            ProjectedPt = Point * (1 - pull) + pull * Ray2.PointAt(RayPt2);
          }
          else
          {
            ProjectedPt = Point * (1 - pull) + pull * M.ClosestPoint(Point);
          }

          P.Vertices.SetVertex(i, ProjectedPt);
        }
        });




      P.Compact(); //this cleans the mesh data structure of unused elements

    }
    A = P;
# ---------- c_script_6: C# additional code ----------
  private Vector3d Normal(PlanktonMesh P, int V)
  {
    Point3d Vertex = P.Vertices[V].ToPoint3d();
    Vector3d Norm = new Vector3d();

    int[] OutEdges = P.Vertices.GetHalfedges(V);
    int[] Neighbours = P.Vertices.GetVertexNeighbours(V);
    Vector3d[] OutVectors = new Vector3d[Neighbours.Length];
    int Valence = P.Vertices.GetValence(V);

    for (int j = 0; j < Valence; j++)
    {
      OutVectors[j] = P.Vertices[Neighbours[j]].ToPoint3d() - Vertex;
    }

    for (int j = 0; j < Valence; j++)
    {
      if (P.Halfedges[OutEdges[(j + 1) % Valence]].AdjacentFace != -1)
      {
        Norm += (Vector3d.CrossProduct(OutVectors[(j + 1) % Valence], OutVectors[j]));
      }
    }

    Norm.Unitize();
    return Norm;
  }

  private Point3d MidPt(PlanktonMesh P, int E)
  {
    Point3d Pos1 = P.Vertices[P.Halfedges[2 * E].StartVertex].ToPoint3d();
    Point3d Pos2 = P.Vertices[P.Halfedges[2 * E + 1].StartVertex].ToPoint3d();
    return (Pos1 + Pos2) * 0.5;
  }
  private static Vector3d[] LaplacianSmooth(PlanktonMesh P, int W, double Strength)
  {
    int VertCount = P.Vertices.Count;
    Vector3d[] Smooth = new Vector3d[VertCount];

    Parallel.For(0, VertCount, i =>
      {
      if ((P.Vertices[i].IsUnused == false) && (P.Vertices.IsBoundary(i) == false))
      {
        int[] Neighbours = P.Vertices.GetVertexNeighbours(i);
        Point3d Vertex = P.Vertices[i].ToPoint3d();
        Point3d Centroid = new Point3d();
        if (W == 0)
        {
          for (int j = 0; j < Neighbours.Length; j++)
          { Centroid = Centroid + P.Vertices[Neighbours[j]].ToPoint3d(); }
          Smooth[i] = ((Centroid * (1.0 / P.Vertices.GetValence(i))) - Vertex) * Strength;
        }
        if (W == 1)
        {
          //get the radial vectors of the 1-ring
          //get the vectors around the 1-ring
          //get the cotangent weights for each edge

          int valence = Neighbours.Length;

          Point3d[] NeighbourPts = new Point3d[valence];
          Vector3d[] Radial = new Vector3d[valence];
          Vector3d[] Around = new Vector3d[valence];
          double[] CotWeight = new double[valence];
          double WeightSum = 0;

          for (int j = 0; j < valence; j++)
          {
            NeighbourPts[j] = P.Vertices[Neighbours[j]].ToPoint3d();
            Radial[j] = NeighbourPts[j] - Vertex;
          }

          for (int j = 0; j < valence; j++)
          {
            Around[j] = NeighbourPts[(j + 1) % valence] - NeighbourPts[j];
          }

          for (int j = 0; j < Neighbours.Length; j++)
          {
            //get the cotangent weights
            int previous = (j + valence - 1) % valence;
            Vector3d Cross1 = Vector3d.CrossProduct(Radial[previous], Around[previous]);
            double Cross1Length = Cross1.Length;
            double Dot1 = Radial[previous] * Around[previous];

            int next = (j + 1) % valence;
            Vector3d Cross2 = Vector3d.CrossProduct(Radial[next], Around[j]);
            double Cross2Length = Cross2.Length;
            double Dot2 = Radial[next] * Around[j];

            CotWeight[j] = Math.Abs(Dot1 / Cross1Length) + Math.Abs(Dot2 / Cross2Length);
            WeightSum += CotWeight[j];
          }

          double InvWeightSum = 1.0 / WeightSum;

          Vector3d ThisSmooth = new Vector3d();

          for (int j = 0; j < Neighbours.Length; j++)
          {
            ThisSmooth = ThisSmooth + Radial[j] * CotWeight[j];
          }

          Smooth[i] = ThisSmooth * InvWeightSum * Strength;
        }

      }
      });
    return Smooth;
  }

  private int[] EdgePairPaths (PlanktonMesh p)
  {
    bool[] uneven = new bool[p.Vertices.Count];
    bool[] naked = new bool[p.Vertices.Count];
    List<int> vs = new List<int>();

    for(int i = 0;i < p.Vertices.Count;i++)
    {
      //Get Valence
      int he = p.Vertices[i].OutgoingHalfedge;
      int val = 0;
      foreach(int nh in p.Halfedges.GetVertexCirculator(he))
      {
        if(p.Halfedges[nh].AdjacentFace == -1){val = 0;break;}
        val++;
      }
      uneven[i] = val % 2 != 0;
      naked[i] = val == 0;
      if(uneven[i]) vs.Add(i);
    }
    if(vs.Count == 0) return new int[0];

    int[] uneven_vertices = vs.ToArray();
    bool[] ispaired = new bool[uneven_vertices.Length];
    List<int> edges = new List<int>();
    bool[] isinpath = new bool[p.Faces.Count];

    for(int i = 0;i < uneven_vertices.Length;i++)
    {
      if(!ispaired[i])
      {
        int[] queue = new int[p.Vertices.Count];
        bool[] inqueue = new bool[p.Vertices.Count];
        int quelast = -1;
        int quepointer = 0;
        int[] backrecords = new int[p.Vertices.Count];
        int[] edgerecords = new int[p.Vertices.Count];

        //start bfs
        quelast++;
        queue[quelast] = uneven_vertices[i];
        inqueue[uneven_vertices[i]] = true;
        while( quelast >= quepointer)
        {
          int vhere = queue[quepointer];
          quepointer++;

          foreach(int nh in p.Halfedges.GetVertexCirculator(p.Vertices[vhere].OutgoingHalfedge))
          {
            if(p.Halfedges[nh].AdjacentFace != -1
              && p.Halfedges[p.Halfedges.GetPairHalfedge(p.Halfedges[nh].NextHalfedge)].AdjacentFace != -1)
            {
              int nexth = p.Halfedges[nh].NextHalfedge;
              int nextv = p.Halfedges[p.Halfedges[p.Halfedges.GetPairHalfedge(nexth)].PrevHalfedge].StartVertex;

              int nextf1 = p.Halfedges[nh].AdjacentFace;
              int nextf2 = p.Halfedges[p.Halfedges.GetPairHalfedge(nexth)].AdjacentFace;
              if (!inqueue[nextv] && !isinpath[nextf1] && !isinpath[nextf2])
              {
                backrecords[nextv] = vhere;
                edgerecords[nextv] = nexth;
                if(uneven[nextv] || naked[nextv])
                {
                  int targetindex = vs.IndexOf(nextv);
                  if(targetindex != -1)
                  {
                    if(ispaired[targetindex] == true)
                    {
                      inqueue[nextv] = true;
                      quelast++;
                      queue[quelast] = nextv;
                    }
                    else
                    {
                      ispaired[i] = true;
                      ispaired[targetindex] = true;

                      int backptr = nextv;
                      while(backptr != uneven_vertices[i])
                      {
                        isinpath[p.Halfedges[edgerecords[backptr]].AdjacentFace] = true;
                        isinpath[p.Halfedges[p.Halfedges.GetPairHalfedge(edgerecords[backptr])].AdjacentFace] = true;
                        edges.Add(edgerecords[backptr]);
                        backptr = backrecords[backptr];
                      }
                      quepointer = 0;
                      quelast = -1;
                      break;
                    }
                  }
                  else
                  {
                    ispaired[i] = true;

                    int backptr = nextv;
                    while(backptr != uneven_vertices[i])
                    {
                      edges.Add(edgerecords[backptr]);
                      isinpath[p.Halfedges[edgerecords[backptr]].AdjacentFace] = true;
                      isinpath[p.Halfedges[p.Halfedges.GetPairHalfedge(edgerecords[backptr])].AdjacentFace] = true;
                      backptr = backrecords[backptr];
                    }
                    quepointer = 0;
                    quelast = -1;
                    break;
                  }
                }
                else
                {
                  inqueue[nextv] = true;
                  quelast++;
                  queue[quelast] = nextv;
                }
              }
            }
          }
        }
      }
    }
    return edges.ToArray();
  }

  private void EvenRemesh (PlanktonMesh p)
  {
    p.Compact();
    int[] edgePaths = EdgePairPaths(p);
    if(edgePaths.Length == 0)return;

    for(int i = 0;i < edgePaths.Length;i++)
    {
      int edge = edgePaths[i];

      var V1 = p.Vertices.GetValence(p.Halfedges[p.Halfedges[edge].PrevHalfedge].StartVertex);
      var V2 = p.Vertices.GetValence(p.Halfedges[p.Halfedges[p.Halfedges.GetPairHalfedge(edge)].PrevHalfedge].StartVertex);
      var V3 = p.Vertices.GetValence(p.Halfedges[edge].StartVertex);
      var V4 = p.Vertices.GetValence(p.Halfedges[p.Halfedges.GetPairHalfedge(edge)].StartVertex);
      bool collapse = ((V1 + V2 > 12 && V1 != 0 && V2 != 0) || (V1 == 0 && V2 > 6) || (V2 == 0 && V1 > 6)) && (V3 + V4 - 4 < 8);
      if(!collapse)
      {
        p.Halfedges.TriangleSplitEdge(edge);
      }

      else
      {
        int Collapsed = p.Halfedges[edge].StartVertex;
        p.Vertices.SetVertex(Collapsed, MidPt(p, edge / 2));
        p.Halfedges.CollapseEdge(edge);
      }

    }
  }
# ---------- end c_script_6 ----------
c_script_7 = CSharpScript(
    x=mesh_3,
    y=c_script_5.path,
    Reference=["C:\USERS\YANGW\APPDATA\ROAMING\GRASSHOPPER\LIBRARIES\KANGAROO0099\Plankton.dll", "C:\USERS\YANGW\APPDATA\ROAMING\GRASSHOPPER\LIBRARIES\KANGAROO0099\PlanktonGh.dll"])  # -> out, A; inputs x: Mesh, y: list of Int32
# ---------- c_script_7: C# ----------
    var p = x.ToPlanktonMesh();
    foreach(var yy in y)
    {
      p.Halfedges.TriangleSplitEdge(yy);
    }
    p.Compact();
    for(int i = 0 ;i < p.Vertices.Count;i++)
    {
      if(!p.Vertices.IsBoundary(i))
      {Print("{0}", p.Vertices.GetValence(i));}
      else
      {
        Print(null);
      }
    }
    A = p;
# ---------- end c_script_7 ----------
planktonmesh_2 = PlanktonMesh(c_script_7.A)
planktonmesh_3 = PlanktonMesh(c_script_6.A)
explode_tree = ExplodeTree(Data=c_script_7.out)
mesh_4 = Mesh(planktonmesh_3)
mesh_5 = Mesh(planktonmesh_2)
c_script_8 = CSharpScript(x=explode_tree)  # -> out, A; inputs x: Int32; same code as c_script_3
combine_clean_2 = CombineClean(Meshes=mesh_5)
c_script_9 = CSharpScript(
    mesh=combine_clean_2,
    offset=Slider(1, range=0..100),
    breakpoint=renameplz,
    Reference=["C:\USERS\YANGW\APPDATA\ROAMING\GRASSHOPPER\LIBRARIES\KANGAROO0099\Plankton.dll", "C:\USERS\YANGW\APPDATA\ROAMING\GRASSHOPPER\LIBRARIES\KANGAROO0099\PlanktonGh.dll"])  # -> out, A, B, C, D, E, F; inputs mesh: Mesh, offset: Double, breakpoint: Int32
# ---------- c_script_9: C# ----------
    var nms = mesh.Normals;
    var p = mesh.ToPlanktonMesh();

    int ph;
    bool[] isnaked = new bool[nms.Count];
    int[] heindex = new int[p.Halfedges.Count];
    int[] vals = new int[nms.Count];
    Point3d[][] offsetpts = new Point3d[nms.Count][];
    int [][] ordermap = new int[nms.Count][];
    int[][] outhes = new int[nms.Count][];

    for(int i = 0;i < nms.Count;i++)
    {
      List<int> oh = new List<int>();
      isnaked[i] = false;
      Point3d here = p.Vertices[i].ToPoint3d();
      vals[i] = 0;
      foreach (int h in p.Halfedges.GetVertexCirculator(p.Vertices[i].OutgoingHalfedge))
      {
        ph = p.Halfedges.GetPairHalfedge(h);
        var end = p.Vertices[p.Halfedges[ph].StartVertex];

        oh.Add(h);
        if(p.Halfedges[h].AdjacentFace == -1 || p.Halfedges[ph].AdjacentFace == -1)
        {
          heindex[h] = -1;isnaked[i] = true;
        }
        else
        {
          heindex[h] = vals[i];vals[i]++;
        }
      }
      outhes[i] = oh.ToArray();
      if(isnaked[i])
      {
        offsetpts[i] = new Point3d[vals[i]];
        ordermap[i] = new int[vals[i]];
        here -= Vector3d.Multiply(nms[i], offset * (vals[i] - 1) / 2);
        for(int j = 0;j < vals[i];j++)
        {
          offsetpts[i][j] = here + Vector3d.Multiply(nms[i], j * offset);
          ordermap[i][j] = j;
        }
      }
      else
      {
        offsetpts[i] = new Point3d[vals[i] / 2];
        ordermap[i] = new int[vals[i] / 2];
        here -= Vector3d.Multiply(nms[i], offset * (vals[i] - 1) / 4);
        for(int j = 0;j < vals[i] / 2;j++)
        {
          offsetpts[i][j] = here + Vector3d.Multiply(nms[i], j * offset);
          ordermap[i][j] = j;
        }
      }
    }
    A = offsetpts;
    B = vals;



    /*bool[] errorpt = new bool[nms.Count];
    bool[] errore = new bool[p.Halfedges.Count / 2];
    List<int> errorv = new List<int>();
    for(int i = 0;i < p.Halfedges.Count / 2;i++)
    {

      int vs = p.Halfedges[2 * i].StartVertex;
      int ve = p.Halfedges[2 * i + 1].StartVertex;
      int he = 2 * i;
      int phe = 2 * i + 1;
      if(p.Halfedges[he].AdjacentFace != -1 && p.Halfedges[phe].AdjacentFace != -1)
      {
        int pstart;
        int pend;
        if(!isnaked[vs])
        {pstart = ordermap[vs][heindex[he] >= vals[vs] / 2 ? ( heindex[he] - vals[vs] / 2 ) : heindex[he]];}
        else
        {pstart = ordermap[vs][heindex[he]];}
        if(!isnaked[ve])
        {pend = ordermap[ve][heindex[phe] >= vals[ve] / 2 ? (heindex[phe] - vals[ve] / 2) : heindex[phe]];}
        else
        {pend = ordermap[ve][heindex[phe]];}
        errore[i] = (pstart == 0 && pend == 0) || (pstart == (ordermap[vs].Length - 1) && pend == (ordermap[ve].Length - 1));
        if(errore[i])
        {
          if(errorpt[vs] != true)
          {errorpt[vs] = true;errorv.Add(vs);}
          if(errorpt[ve] != true)
          {errorpt[ve] = true;errorv.Add(ve);}
        }
      }
    }*/

    bool[] errore;
    bool[] errorpt;
    bool[] errortype;
    JitterMap(ordermap);
    int currenterror = GetErrorCount(p, vals, isnaked, ordermap, heindex, out errorpt, out errore, out errortype);
    int iter = 0;

    //!!!!!!!!!!!!!!!!!!!!!!!!!!!!!
    int max = 2000;
    while( currenterror > 0 && iter < max)
    {
      if(iter >= breakpoint)
      {
        break;
      }
      double ratio = (double) iter / (double) max;
      double toler = (0.8 - ratio);
      toler = toler > 0 ? toler : 0;
      int[][] newmap = MCMap(ordermap, errorpt, errortype, ratio);
      bool[] newerrorpt;
      bool[] newerrore;
      bool[] newerrortype;
      int targeterror = GetErrorCount(p, vals, isnaked, newmap, heindex, out newerrorpt, out newerrore, out newerrortype);
      if(targeterror <= currenterror + toler * 1000)
      {
        currenterror = targeterror;
        ordermap = newmap;
        errorpt = newerrorpt;
        errore = newerrore;
        errortype = newerrortype;
      }
      iter++;
    }

    E = errorpt;

    List<Line> debug = new List<Line>();
    for(int i = 0;i < p.Halfedges.Count / 2;i++)
    {

      int vs = p.Halfedges[2 * i].StartVertex;
      int ve = p.Halfedges[2 * i + 1].StartVertex;
      int he = 2 * i;
      int phe = 2 * i + 1;
      if(p.Halfedges[he].AdjacentFace != -1 && p.Halfedges[phe].AdjacentFace != -1)
      {
        Point3d pstart;
        Point3d pend;
        if(!isnaked[vs])
        {pstart = offsetpts[vs][ordermap[vs][heindex[he] >= vals[vs] / 2 ? ( heindex[he] - vals[vs] / 2 ) : heindex[he]]];}
        else
        {pstart = offsetpts[vs][ordermap[vs][heindex[he]]];}
        if(!isnaked[ve])
        {pend = offsetpts[ve][ordermap[ve][heindex[phe] >= vals[ve] / 2 ? (heindex[phe] - vals[ve] / 2) : heindex[phe]]];}
        else
        {pend = offsetpts[ve][ordermap[ve][heindex[phe]]];}
        debug.Add(new Line(pstart, pend));
      }
      else{debug.Add(new Line());}
    }

    C = debug;
    D = errore;

    /*List<Polyline> pls = new List<Polyline> ();
    for(int i = 0;i < p.Halfedges.Count / 2;i++)
    {
      int vs = p.Halfedges[2 * i].StartVertex;
      int ve = p.Halfedges[2 * i + 1].StartVertex;
      Vector3d evec = Vector3d.Multiply(p.Vertices[ve].ToPoint3d() - p.Vertices[vs].ToPoint3d(), 0.3);
      int he = 2 * i;
      int phe = 2 * i + 1;
      if(p.Halfedges[he].AdjacentFace != -1 && p.Halfedges[phe].AdjacentFace != -1)
      {
        Point3d pstart;
        Point3d pend;
        if(!isnaked[vs])
        {pstart = offsetpts[vs][ordermap[vs][heindex[he] >= vals[vs] / 2 ? ( heindex[he] - vals[vs] / 2 ) : heindex[he]]];}
        else
        {pstart = offsetpts[vs][ordermap[vs][heindex[he]]];}
        if(!isnaked[ve])
        {pend = offsetpts[ve][ordermap[ve][heindex[phe] >= vals[ve] / 2 ? (heindex[phe] - vals[ve] / 2) : heindex[phe]]];}
        else
        {pend = offsetpts[ve][ordermap[ve][heindex[phe]]];}
        Point3d pstart1 = pstart + evec;
        Point3d pend1 = pend - evec;
        Polyline pline = new Polyline();
        pline.Add(pstart);
        pline.Add(pstart1);
        pline.Add(pend1);
        pline.Add(pend);
        pls.Add(pline);
      }
      else{debug.Add(new Line());}
    }
    F = pls;*/
# ---------- c_script_9: C# additional code ----------
  public int GetErrorCount(PlanktonMesh p, int[] valences, bool[] nakedvertices, int[][] map, int[] halfedge_index_at_start_point, out  bool[] errorplace, out bool[]erroredge, out bool[] errortype)
  {
    bool[] errorpt = new bool[p.Vertices.Count];
    bool[] multerrorpt = new bool[p.Vertices.Count];
    errortype = new bool[p.Vertices.Count];
    bool[] errore = new bool[p.Halfedges.Count / 2];
    int[] heindex = halfedge_index_at_start_point;
    int[] vals = valences;
    bool[] isnaked = nakedvertices;
    int errorcount = 0;
    for(int i = 0;i < p.Halfedges.Count / 2;i++)
    {

      int vs = p.Halfedges[2 * i].StartVertex;
      int ve = p.Halfedges[2 * i + 1].StartVertex;
      int he = 2 * i;
      int phe = 2 * i + 1;
      if(p.Halfedges[he].AdjacentFace != -1 && p.Halfedges[phe].AdjacentFace != -1)
      {
        int pstart;
        int pend;
        if(!isnaked[vs])
        {pstart = map[vs][heindex[he] >= vals[vs] / 2 ? ( heindex[he] - vals[vs] / 2 ) : heindex[he]];}
        else
        {pstart = map[vs][heindex[he]];}
        if(!isnaked[ve])
        {pend = map[ve][heindex[phe] >= vals[ve] / 2 ? (heindex[phe] - vals[ve] / 2) : heindex[phe]];}
        else
        {pend = map[ve][heindex[phe]];}
        bool t = (pstart == 0 && pend == 0);
        errore[i] = t || (pstart == (map[vs].Length - 1) && pend == (map[ve].Length - 1));

        if(errore[i])
        {
          errorcount++;
          if(errorpt[vs] != true)
          {
            errorpt[vs] = true;
            errortype[vs] = t;
          }
          else if(errorpt[vs] == true && multerrorpt[vs] != true)
          {
            multerrorpt[vs] = true;
          }
          if(errorpt[ve] != true)
          {
            errorpt[ve] = true;
            errortype[ve] = t;
          }
          else if(errorpt[ve] == true && multerrorpt[ve] != true)
          {
            multerrorpt[ve] = true;
          }
        }
      }
    }
    erroredge = errore;
    errorplace = errorpt;
    return errorcount;
  }
  public int[][] MCMap(int[][] map, bool[] errorplace, bool[] errortype, double t)
  {
    Random r = new Random(10);
    int[][] output = new int[map.Length][];
    for(int i = 0; i < map.Length;i++)
    {
      output[i] = new int[map[i].Length];
      for(int k = 0;k < map[i].Length;k++)
      {
        int d = map[i][k];
        output[i][k] = d;
      }
      if(errorplace[i] && r.NextDouble() > t)
      {
        int temp;
        if(errortype[i])
        {
          if(map[i].Length != 1)
          {
            int swaptarget = (int) r.NextDouble() * (map[i].Length - 1) + 1;
            temp = output[i][0];
            output[i][0] = output[i][swaptarget];
            output[i][swaptarget] = temp;
          }
        }
        else
        {
          int swaptarget = (int) r.NextDouble() * (map[i].Length - 1);
          temp = output[i][map[i].Length - 1];
          output[i][map[i].Length - 1] = output[i][swaptarget];
          output[i][swaptarget] = temp;
        }
      }
    }
    return output;
  }
  public void JitterMap(int[][] map)
  {
    Random r = new Random(12);
    for(int i = 0; i < map.Length;i++)
    {
      for(int k = 0;k < map[i].Length;k++)
      {
        int swaptarget = (int) r.NextDouble() * map[i].Length;
        int temp = map[i][k];
        map[i][k] = map[i][swaptarget];
        map[i][swaptarget] = temp;
      }
    }
  }
# ---------- end c_script_9 ----------
curve = Curve(c_script_9.C)
cull_pattern = CullPattern(List=curve, CullPattern=invert(c_script_9.D))
cull_pattern_2 = CullPattern(List=graft(explode_tree), CullPattern=invert(graft(c_script_8.A)))
integer = Integer(flatten(cull_pattern_2))
panel = Panel(integer)
